# Dynamo graph PARK_ContadorEstacionamientos.dyn "PARK_Contador Estacionamientos" (Dynamo 2.3.0.5885)

string = StringInput("Parking")
byName = Category.ByName(name=string)

# group: SPLITTER DE CONTADORES
all_elements_of_category = ElementsOfCategory(Category=byName)
string_2 = StringInput("PARK_Medio")  # graph input

filter_by_primary_design_option = Python(IN[0]=all_elements_of_category)
# ---------- filter_by_primary_design_option.python (64 lines) ----------
import clr
import sys

clr.AddReference("System")
from System.Collections.Generic import List

clr.AddReference("DSCoreNodes")
import DSCore
from DSCore import *

#Import RevitAPI
clr.AddReference('RevitAPI')
from Autodesk.Revit.DB import *

#Import RevitAPIUI
clr.AddReference("RevitAPIUI")

#Import DocumentManager and TransactionManager
clr.AddReference("RevitServices")
import RevitServices
from RevitServices.Persistence import DocumentManager

#Import Dynamo Python References
clr.AddReference("ProtoGeometry")
from Autodesk.DesignScript.Geometry import *

#Import RevitNodes
clr.AddReference("RevitNodes")
import Revit

clr.ImportExtensions(Revit.Elements)
clr.ImportExtensions(Revit.GeometryConversion)

doc = DocumentManager.Instance.CurrentDBDocument

group = IN[0]
elementDesignOptionName = []
element = []

for i in group:
	element = UnwrapElement(i)
#	elementIds.append(element.DesignOption)
	elementDesignOption = (element.DesignOption)
	if elementDesignOption is not None:
		elementDesignOptionName.append(elementDesignOption.Name)
	if elementDesignOption is None:
		elementDesignOptionName.append("primary")
		
elementBoolState = []
desingOptionString = "primary"

for i in elementDesignOptionName:
	if desingOptionString in i:
		elementBoolState.append(True)
	if desingOptionString not in i:
		elementBoolState.append(False)

elementOutput = []

for index in range(len(elementBoolState)):
	if elementBoolState[index] is True:
		elementOutput.append(group[index])

OUT = elementOutput
# ----------------------------------------
watch = Watch(filter_by_primary_design_option)

# group (continued): SPLITTER DE CONTADORES
elementType = Element.ElementType(element=watch)
getParameterValueByName = Element.GetParameterValueByName(element=elementType, parameterName=string_2)

# group: CONTADOR DE ESTACIONAMIENTOS BICICLETA
string_3 = StringInput("BICICLETA")  # graph input
eq = string_3 == getParameterValueByName
filterByBoolMask = List.FilterByBoolMask(list=watch, mask=eq)
count = List.Count(list=filterByBoolMask.in)

# group: CONTADOR ESTACIONAMIENTOS MOVILIDAD REDUCIDA
number = DoubleInput(1)  # graph input
string_4 = StringInput("VIS_AccesibilidadUniversal")  # graph input
getParameterValueByName_2 = Element.GetParameterValueByName(element=watch, parameterName=string_4)
eq_2 = number == getParameterValueByName_2
filterByBoolMask_2 = List.FilterByBoolMask(list=watch, mask=eq_2)
count_2 = List.Count(list=filterByBoolMask_2.in)

# group: CONTADOR ESTACIONAMIENTOS AUTO
string_5 = StringInput("AUTO")  # graph input
eq_3 = string_5 == getParameterValueByName
filterByBoolMask_3 = List.FilterByBoolMask(list=watch, mask=eq_3)
count_3 = List.Count(list=filterByBoolMask_3.in)

number_2 = DoubleInput(3)
maximo_tandem = count_3 / number_2
tandem_b05 = DoubleInput(45)
tandem_b05_2 = DoubleInput(2)
mul = tandem_b05 * tandem_b05_2
tandem_b04 = DoubleInput(42)
mul_2 = tandem_b04 * tandem_b05_2
add = mul + mul_2
sub = maximo_tandem - add
watch_2 = Watch(sub)
categories = Categories("OST_GenericAnnotation")
string_6 = StringInput("Generic Annotations")
byName_2 = Category.ByName(name=string_6)
all_elements_of_category_2 = ElementsOfCategory(Category=byName_2)
name = Element.Name(element=all_elements_of_category_2)
string_7 = StringInput("GANNO_VIÑETA ESTACIONAMIENTOS PISO")
eq_4 = name == string_7
filterByBoolMask_4 = List.FilterByBoolMask(list=all_elements_of_category_2, mask=eq_4)
parameters = Element.Parameters(element=filterByBoolMask_4.in)
watch_3 = Watch(parameters)
