# Dynamo graph PARK_EnumeradorEstacionamientos.dyn (Dynamo 2.3.0.5885)

string = StringInput("Parking")
byName = Category.ByName(name=string)
all_elements_of_category = ElementsOfCategory(Category=byName)
parameters = Element.Parameters(element=all_elements_of_category)
watch = Watch(parameters)
current = Document.Current()
activeView = Document.ActiveView(document=current)
true_cantidad_manual_false_todo = BoolSelector(true)  # "TRUE: CANTIDAD MANUAL | FALSE: TODO EL PISO"; graph input
cantidad_estacionamientos = DoubleInput(0)  # graph input
string_2 = StringInput("Levels")
byName_2 = Category.ByName(name=string_2)
all_elements_of_category_2 = ElementsOfCategory(Category=byName_2)
current_2 = Document.Current()
activeView_2 = Document.ActiveView(document=current_2)
string_3 = StringInput("Associated Level")
getParameterValueByName = Element.GetParameterValueByName(element=activeView_2, parameterName=string_3)
name = Element.Name(element=all_elements_of_category_2)
eq = getParameterValueByName == name
filterByBoolMask = List.FilterByBoolMask(list=all_elements_of_category_2, mask=eq)
string_4 = StringInput("LEVELS_N°")
getParameterValueByName_2 = Element.GetParameterValueByName(element=filterByBoolMask.in, parameterName=string_4)
string_5 = StringInput("Level")
getParameterValueByName_3 = Element.GetParameterValueByName(element=all_elements_of_category, parameterName=string_5)
string_6 = StringInput("LEVELS_N°")
getParameterValueByName_4 = Element.GetParameterValueByName(element=getParameterValueByName_3, parameterName=string_6)
eq_2 = getParameterValueByName_2@L1 == getParameterValueByName_4
flatten = List.Flatten(list=eq_2)
string_7 = StringInput("A250 L500")
elementType = Element.ElementType(element=all_elements_of_category)
name_2 = Element.Name(element=elementType)
eq_3 = string_7 == name_2
flatten_2 = List.Flatten(list=eq_3)
and_ = flatten && flatten_2
flatten_3 = List.Flatten(list=and_)
filterByBoolMask_2 = List.FilterByBoolMask(list=all_elements_of_category, mask=flatten_3)
count = List.Count(list=filterByBoolMask_2.in)
watch_2 = Watch(count)
true_cantidad_manual_false_todo_2 = If(test=true_cantidad_manual_false_todo, true=cantidad_estacionamientos, false=watch_2)  # "TRUE: CANTIDAD MANUAL | FALSE: TODO EL PISO"
pickObjectsInOrder = Python(IN[0]=true_cantidad_manual_false_todo_2)
# ---------- pickObjectsInOrder.python (57 lines) ----------
import clr
import sys

clr.AddReference("System")
from System.Collections.Generic import *

clr.AddReference("DSCoreNodes")
import DSCore
from DSCore import *

#Import RevitAPI
clr.AddReference('RevitAPI')
from Autodesk.Revit.DB import *

#Import RevitAPIUI
clr.AddReference("RevitAPIUI")
from Autodesk.Revit.UI import *
from Autodesk.Revit.UI.Selection import ISelectionFilter
#Import DocumentManager and TransactionManager
clr.AddReference("RevitServices")
import RevitServices
from RevitServices.Persistence import DocumentManager

#Import Dynamo Python References
clr.AddReference("ProtoGeometry")
from Autodesk.DesignScript.Geometry import *

#Import RevitNodes
clr.AddReference("RevitNodes")
import Revit

clr.ImportExtensions(Revit.Elements)
clr.ImportExtensions(Revit.GeometryConversion)

class CustomPickFilter(ISelectionFilter):
    def __init__(self, nom_categorie):
        self.nom_categorie = nom_categorie
    def AllowElement(self, e):
        if e.Category.Name == self.nom_categorie:
            return True
        else:
            return False
    def AllowReference(self, ref, point):
        return true


doc = DocumentManager.Instance.CurrentDBDocument
uidoc = DocumentManager.Instance.CurrentUIApplication.ActiveUIDocument
sel = uidoc.Selection
obType = Selection.ObjectType.Element
elementList = []
pos = 0
for i in range(IN[0]):
	ref = sel.PickObject(obType, CustomPickFilter("Parking"))
	elementList.append(doc.GetElement(ref.ElementId))

OUT = elementList
# ----------------------------------------
string_8 = StringInput("PARK_Número")
serie_con_la_cual_empezar = DoubleInput(5000)  # graph input
count_2 = List.Count(list=pickObjectsInOrder)
add = serie_con_la_cual_empezar + count_2
number = DoubleInput(1)
sub = add - number
range = Range(start=serie_con_la_cual_empezar, end=sub, step=number)
string_from_object = FromObject(obj=range)
watch_3 = Watch(string_from_object)
setParameterByName = Element.SetParameterByName(element=pickObjectsInOrder, parameterName=string_8, value=watch_3)
boolean = BoolSelector(true)
boolean_2 = BoolSelector(false)
select_horizontal_text_alignment = HorizontalAlignment("Center")
select_vertical_text_alignment = VerticalAlignment("Middle")
byElement = Tag.ByElement(view=activeView, element=setParameterByName, horizontal=boolean, addLeader=boolean_2, horizontalAlignment=select_horizontal_text_alignment, verticalAlignment=select_vertical_text_alignment)
string_9 = StringInput("Family and Type")
seleccion_de_tag = FamilyTypes("TAG_PARKING_Numero:Sólo N°")  # graph input
setParameterByName_2 = Element.SetParameterByName(element=byElement, parameterName=string_9, value=seleccion_de_tag)
parameters_2 = Element.Parameters(element=byElement)
watch_4 = Watch(parameters_2)
