# Dynamo graph PARK_TandemViewer.dyn (Dynamo 2.3.0.5885)

string = StringInput("Parking")
byName = Category.ByName(name=string)

# group: SPLITTER DE CONTADORES
all_elements_of_category = ElementsOfCategory(Category=byName)
string_2 = StringInput("PARK_Medio")

filter_by_primary_design_option = Python(IN[0]=all_elements_of_category)
# ---------- filter_by_primary_design_option.python (64 lines) ----------
import clr
import sys

clr.AddReference("System")
from System.Collections.Generic import List

clr.AddReference("DSCoreNodes")
import DSCore
from DSCore import *

#Import RevitAPI
clr.AddReference('RevitAPI')
from Autodesk.Revit.DB import *

#Import RevitAPIUI
clr.AddReference("RevitAPIUI")

#Import DocumentManager and TransactionManager
clr.AddReference("RevitServices")
import RevitServices
from RevitServices.Persistence import DocumentManager

#Import Dynamo Python References
clr.AddReference("ProtoGeometry")
from Autodesk.DesignScript.Geometry import *

#Import RevitNodes
clr.AddReference("RevitNodes")
import Revit

clr.ImportExtensions(Revit.Elements)
clr.ImportExtensions(Revit.GeometryConversion)

doc = DocumentManager.Instance.CurrentDBDocument

group = IN[0]
elementDesignOptionName = []
element = []

for i in group:
	element = UnwrapElement(i)
#	elementIds.append(element.DesignOption)
	elementDesignOption = (element.DesignOption)
	if elementDesignOption is not None:
		elementDesignOptionName.append(elementDesignOption.Name)
	if elementDesignOption is None:
		elementDesignOptionName.append("primary")
		
elementBoolState = []
desingOptionString = "primary"

for i in elementDesignOptionName:
	if desingOptionString in i:
		elementBoolState.append(True)
	if desingOptionString not in i:
		elementBoolState.append(False)

elementOutput = []

for index in range(len(elementBoolState)):
	if elementBoolState[index] is True:
		elementOutput.append(group[index])

OUT = elementOutput
# ----------------------------------------
watch = Watch(filter_by_primary_design_option)

# group (continued): SPLITTER DE CONTADORES
elementType = Element.ElementType(element=watch)
getParameterValueByName = Element.GetParameterValueByName(element=elementType, parameterName=string_2)

# group: CONTADOR ESTACIONAMIENTOS AUTO
string_3 = StringInput("AUTO")
eq = string_3 == getParameterValueByName
filterByBoolMask = List.FilterByBoolMask(list=watch, mask=eq)
count = List.Count(list=filterByBoolMask.in)

# group: CONTADOR DE ESTACIONAMIENTOS BICICLETA
string_4 = StringInput("BICICLETA")
eq_2 = string_4 == getParameterValueByName
filterByBoolMask_2 = List.FilterByBoolMask(list=watch, mask=eq_2)
count_2 = List.Count(list=filterByBoolMask_2.in)

# group: CONTADOR ESTACIONAMIENTOS MOVILIDAD REDUCIDA
number = DoubleInput(1)
string_5 = StringInput("VIS_AccesibilidadUniversal")
getParameterValueByName_2 = Element.GetParameterValueByName(element=watch, parameterName=string_5)
eq_3 = number == getParameterValueByName_2
filterByBoolMask_3 = List.FilterByBoolMask(list=watch, mask=eq_3)
count_3 = List.Count(list=filterByBoolMask_3.in)

string_6 = StringInput("Generic Annotations")
byName_2 = Category.ByName(name=string_6)
all_elements_of_category_2 = ElementsOfCategory(Category=byName_2)
string_7 = StringInput("GANNO_VIÑETA ESTACIONAMIENTOS PISO")
name = Element.Name(element=all_elements_of_category_2)
eq_4 = string_7 == name
filterByBoolMask_4 = List.FilterByBoolMask(list=all_elements_of_category_2, mask=eq_4)
watch_2 = Watch(filterByBoolMask_4.in)
filterByBoolMask_5 = List.FilterByBoolMask(list=all_elements_of_category_2, mask=eq_4)
string_8 = StringInput("Nivel")
string_9 = StringInput("Levels")
byName_3 = Category.ByName(name=string_9)

# group: NOMBRE PISOS Y FILTRO DE PISOS CON VIÑETA
python_script = Python(IN[0]=filterByBoolMask_5.in)
# ---------- python_script.python (21 lines) ----------
import clr

clr.AddReference("RevitServices")
import RevitServices
from RevitServices.Persistence import DocumentManager
doc =  DocumentManager.Instance.CurrentDBDocument

if isinstance(IN[0], list):
	tags = UnwrapElement(IN[0])
else:
	tags = [UnwrapElement(IN[0])]

listout = []

for x in tags:
	Id = x.OwnerViewId
	view = doc.GetElement(Id)
	listout.append(view)


OUT = listout
# ----------------------------------------
string_10 = StringInput("Associated Level")
getParameterValueByName_3 = Element.GetParameterValueByName(element=python_script, parameterName=string_10)
watch_3 = Watch(getParameterValueByName_3)
all_elements_of_category_3 = ElementsOfCategory(Category=byName_3)
string_11 = StringInput("Name")
getParameterValueByName_4 = Element.GetParameterValueByName(element=all_elements_of_category_3, parameterName=string_11)
string_12 = StringInput("LEVELS_N°")
getParameterValueByName_5 = Element.GetParameterValueByName(element=all_elements_of_category_3, parameterName=string_12)
translator = Custom[Translator](ToTranslate=getParameterValueByName_3, FromList=getParameterValueByName_4, TranslationsList=getParameterValueByName_5)

string_13 = StringInput("LEVELS_NombreMunicipal")
getParameterValueByName_6 = Element.GetParameterValueByName(element=all_elements_of_category_3, parameterName=string_13)
translator_2 = Custom[Translator](ToTranslate=getParameterValueByName_3, FromList=getParameterValueByName_4, TranslationsList=getParameterValueByName_6)
toNumber = String.ToNumber(str=translator_2)
watch_4 = Watch(filterByBoolMask.in)
parameters = Element.Parameters(element=watch_4)
watch_5 = Watch(parameters)
string_14 = StringInput("Level")
getParameterValueByName_7 = Element.GetParameterValueByName(element=watch_4, parameterName=string_14)
getParameterValueByName_8 = Element.GetParameterValueByName(element=getParameterValueByName_7, parameterName=string_12)
groupByKey = List.GroupByKey(list=watch_4, keys=getParameterValueByName_8)
byKeysValues = DesignScript.Builtin.Dictionary.ByKeysValues(keys=groupByKey.unique_keys, values=groupByKey.groups)
uniqueItems = List.UniqueItems(list=translator)
valueAtKey = DesignScript.Builtin.Dictionary.ValueAtKey(dictionary=byKeysValues, key=uniqueItems)
string_15 = StringInput("PARK_Tandem")
getParameterValueByName_9 = Element.GetParameterValueByName(element=valueAtKey, parameterName=string_15)
number_2 = DoubleInput(1)
eq_5 = getParameterValueByName_9 == number_2
filterByBoolMask_6 = List.FilterByBoolMask(list=valueAtKey, mask=eq_5)
watch_6 = Watch(filterByBoolMask_6.in)
geometry = Element.Geometry(element=watch_6)
tandem_viewer = Watch3D(geometry)  # graph output
