# Dynamo graph SHEET_DataLink.dyn "SHEET_Data Link" (Dynamo 2.3.0.5885)

string = StringInput("Sheets")
byName = Category.ByName(name=string)
all_elements_of_category = ElementsOfCategory(Category=byName)
watch = Watch(all_elements_of_category)
nombre_grupo = StringInput("2.MUNICIPAL")  # graph input
string_2 = StringInput("GEN_GRUPO")
getParameterValueByName = Element.GetParameterValueByName(element=all_elements_of_category, parameterName=string_2)
eq = nombre_grupo == getParameterValueByName
nombre_sub_grupo = StringInput("ANTEPROYECTO")  # graph input
string_3 = StringInput("GEN_SUB-GRUPO")
getParameterValueByName_2 = Element.GetParameterValueByName(element=all_elements_of_category, parameterName=string_3)
eq_2 = nombre_sub_grupo == getParameterValueByName_2
and_ = eq && eq_2
filterByBoolMask = List.FilterByBoolMask(list=watch, mask=and_)
watch_2 = Watch(filterByBoolMask.in)
string_4 = StringInput("Title Blocks")
byName_2 = Category.ByName(name=string_4)
all_elements_of_category_2 = ElementsOfCategory(Category=byName_2)
watch_3 = Watch(all_elements_of_category_2)
titleblocks_of_sheets = Python(IN[0]=watch_2, IN[1]=watch_3)
# ---------- titleblocks_of_sheets.python (57 lines) ----------
import clr
import sys

clr.AddReference("System")
from System.Collections.Generic import List

clr.AddReference("DSCoreNodes")
import DSCore
from DSCore import *

#Import RevitAPI
clr.AddReference('RevitAPI')
from Autodesk.Revit.DB import *

#Import RevitAPIUI
clr.AddReference("RevitAPIUI")

#Import DocumentManager and TransactionManager
clr.AddReference("RevitServices")
import RevitServices
from RevitServices.Persistence import DocumentManager

#Import Dynamo Python References
clr.AddReference("ProtoGeometry")
from Autodesk.DesignScript.Geometry import *

#Import RevitNodes
clr.AddReference("RevitNodes")
import Revit

clr.ImportExtensions(Revit.Elements)
clr.ImportExtensions(Revit.GeometryConversion)

doc = DocumentManager.Instance.CurrentDBDocument

sheetList = IN[0]
titleblockList = IN[1]
titleList = []



	
sheetNumberSheetList = []
for sheet in sheetList:
	sheetNumber = sheet.SheetNumber
	titleNumberSheetList = []
	for titleblock in titleblockList:
		titleblockNumber = ""
		titleParams = titleblock.Parameters
		for i in titleParams:
			if i.Name == "Sheet Number":
				titleblockNumber = i.Value
				if titleblockNumber == sheetNumber:
					titleList.append(titleblock)
	

OUT = titleList
# ----------------------------------------
string_5 = StringInput("Family")
string_6 = StringInput("Family")
getParameterValueByName_3 = Element.GetParameterValueByName(element=watch_3, parameterName=string_6)
VIÑETA = FamilyTypes("VES_INGRESO ANTEPROYECTO_A0:A0")  # graph input
contains = List.Contains(list=getParameterValueByName_3, item=VIÑETA)
if_ = If(test=contains, true=VIÑETA, false=getParameterValueByName_3)
setParameterByName = Element.SetParameterByName(element=titleblocks_of_sheets, parameterName=string_5, value=if_)
string_7 = StringInput("Anteproyecto")
string_8 = StringInput("CD")
string_9 = StringInput("INGRESO MUNICIPAL")
string_10 = StringInput("SD")
string_11 = StringInput("TD")
string_12 = StringInput("DD")
string_13 = StringInput("Desarrollo")
string_14 = StringInput("Construccion")
string_15 = StringInput("Drawn By")
string_16 = StringInput("Checked By")
string_17 = StringInput("Revision")
list_create = List.Create(item0=string_7, item1=string_8, item2=string_9, item3=string_10, item4=string_11, item5=string_12, item6=string_13, item7=string_14, item8=string_15, item9=string_16, item10=string_17)
ANTEPROYECTO = BoolSelector(false)  # graph input
CD = BoolSelector(false)  # graph input
ingreso_municipal = BoolSelector(false)  # graph input
SD = BoolSelector(false)  # graph input
TD = BoolSelector(false)  # graph input
DD = BoolSelector(false)  # graph input
desarrollo = BoolSelector(false)  # graph input
construccion = BoolSelector(false)  # graph input
DIBUJO = StringInput("JP")  # graph input
REVISO = StringInput("DP")  # graph input
REVISION = StringInput("A")  # graph input
list_create_2 = List.Create(item0=ANTEPROYECTO, item1=CD, item2=ingreso_municipal, item3=SD, item4=TD, item5=DD, item6=desarrollo, item7=construccion, item8=DIBUJO, item9=REVISO, item10=REVISION)
setParameterByName_2 = Element.SetParameterByName(element=setParameterByName, parameterName=list_create@L1, value=list_create_2@L1)
parameters = Element.Parameters(element=watch_3)
