# Dynamo graph SHEET_RenumberBySeries.dyn "SHEET_Renumber by series" (Dynamo 2.3.0.5885)

string = StringInput("Sheets")
byName = Category.ByName(name=string)
all_elements_of_category = ElementsOfCategory(Category=byName)
watch = Watch(all_elements_of_category)
nombre_grupo = StringInput("2.MUNICIPAL")  # graph input
string_2 = StringInput("GEN_GRUPO")
getParameterValueByName = Element.GetParameterValueByName(element=all_elements_of_category, parameterName=string_2)
eq = nombre_grupo == getParameterValueByName
nombre_sub_grupo = StringInput("ANTEPROYECTO")  # graph input
string_3 = StringInput("GEN_SUB-GRUPO")
getParameterValueByName_2 = Element.GetParameterValueByName(element=all_elements_of_category, parameterName=string_3)
eq_2 = nombre_sub_grupo == getParameterValueByName_2
and_ = eq && eq_2
filterByBoolMask = List.FilterByBoolMask(list=watch, mask=and_)
watch_2 = Watch(filterByBoolMask.in)
string_4 = StringInput("Sheet Number")
getParameterValueByName_3 = Element.GetParameterValueByName(element=watch_2, parameterName=string_4)
watch_3 = Watch(getParameterValueByName_3)
sort = List.Sort(list=watch_3)
watch_4 = Watch(sort)
contains = String.Contains(str=watch_4@L1, searchFor=watch_3)
filterByBoolMask_2 = List.FilterByBoolMask(list=watch_2, mask=contains@L2)
flatten = List.Flatten(list=filterByBoolMask_2.in)
string_5 = StringInput("-")
split = String.Split(str=watch_4, separator0=string_5)
number = DoubleInput(-1)
cantidad_de_ceros = DoubleInput(4)
number_2 = DoubleInput(0)
lastItem = List.LastItem(list=split@L2)
count = List.Count(list=lastItem)
number_3 = DoubleInput(1)
range = Range(start=number_2, end=count, step=number_3)
string_from_object = FromObject(obj=range)
length = String.Length(str=string_from_object)
sub = cantidad_de_ceros - length
range_of_zeros = Python(IN[0]=sub, IN[1]=string_from_object)
# ---------- range_of_zeros.python (20 lines) ----------
# Load the Python Standard and DesignScript Libraries
import sys
import clr
clr.AddReference('ProtoGeometry')
from Autodesk.DesignScript.Geometry import *

# The inputs to this node will be stored as a list in the IN variables.
amount = IN[0]
outList = []
valueList = IN[1]

for i in range(len(amount)):
	stringList = []
	for count in range(amount[i]):
		stringList.append("0")
	stringList.append(valueList[i])
	outString = "".join(stringList)
	
	outList.append(outString)
OUT = outList
# ----------------------------------------
watch_5 = Watch(range_of_zeros)
replaceItemAtIndex = List.ReplaceItemAtIndex(list=split@L2, index=number, item=watch_5@L1)
join = String.Join(separator=string_5, string0=replaceItemAtIndex)
flatten_2 = List.Flatten(list=join)
setParameterByName = Element.SetParameterByName(element=flatten, parameterName=string_4, value=flatten_2)
number_4 = DoubleInput(57)
offset_de_todas = range + number_4
string_6 = StringInput("SHEET_Total Laminas Set")
sub_2 = count - number_3
setParameterByName_2 = Element.SetParameterByName(element=flatten, parameterName=string_6, value=sub_2)
string_7 = StringInput("SHEET_Numero Lamina Set")
setParameterByName_3 = Element.SetParameterByName(element=flatten, parameterName=string_7, value=range@L2)
