# Dynamo graph SLAB_SingleProjector.dyn "SLAB_SINGLE PROJECTOR" (Dynamo 2.0.3.8810)

seleccionar_losa = DSModelElementSelection()  # 1 picked in the model; graph input
watch = Watch(seleccionar_losa)
getAnalyticalModel = Python(IN[0]=watch)
# ---------- getAnalyticalModel.python (55 lines) ----------
import clr
import sys

clr.AddReference("System")
from System.Collections.Generic import List

clr.AddReference("DSCoreNodes")
import DSCore
from DSCore import *

#Import RevitAPI
clr.AddReference('RevitAPI')
from Autodesk.Revit.DB import *

#Import RevitAPIUI
clr.AddReference("RevitAPIUI")

#Import DocumentManager and TransactionManager
clr.AddReference("RevitServices")
import RevitServices
from RevitServices.Persistence import DocumentManager

#Import Dynamo Python References
clr.AddReference("ProtoGeometry")
from Autodesk.DesignScript.Geometry import *

#Import RevitNodes
clr.AddReference("RevitNodes")
import Revit

clr.ImportExtensions(Revit.Elements)
clr.ImportExtensions(Revit.GeometryConversion)



floor = IN[0]

floors = UnwrapElement(floor)
analyticalFloor = floors.GetAnalyticalModel()


OUT = analyticalFloor

"""
name_list = []

for i in floors:
	datum = i.AreaScheme
#	datum = datum.AsValueString()
	name_list.append(datum)


#Assign your output to the OUT variable.
OUT = name_list
"""
# ----------------------------------------
geometry = Element.Geometry(element=getAnalyticalModel)
watch_2 = Watch(geometry)
getAnalyticalModel_2 = Python(IN[0]=watch_2)
# ---------- getAnalyticalModel_2.python (57 lines) ----------
import clr
import sys

clr.AddReference("System")
from System.Collections.Generic import List

clr.AddReference("DSCoreNodes")
import DSCore
from DSCore import *

#Import RevitAPI
clr.AddReference('RevitAPI')
from Autodesk.Revit.DB import *

#Import RevitAPIUI
clr.AddReference("RevitAPIUI")

#Import DocumentManager and TransactionManager
clr.AddReference("RevitServices")
import RevitServices
from RevitServices.Persistence import DocumentManager

#Import Dynamo Python References
clr.AddReference("ProtoGeometry")
from Autodesk.DesignScript.Geometry import *

#Import RevitNodes
clr.AddReference("RevitNodes")
import Revit

clr.ImportExtensions(Revit.Elements)
clr.ImportExtensions(Revit.GeometryConversion)



inputList = IN[0]
typeList = []

for i in inputList:
	type = i.GetType()
	typeList.append(type)


OUT = typeList

"""
name_list = []

for i in floors:
	datum = i.AreaScheme
#	datum = datum.AsValueString()
	name_list.append(datum)


#Assign your output to the OUT variable.
OUT = name_list
"""
# ----------------------------------------
string_from_object = FromObject(obj=getAnalyticalModel_2)
string = StringInput("Autodesk.DesignScript.Geometry.Surface")
eq = string_from_object == string
filterByBoolMask = List.FilterByBoolMask(list=watch_2, mask=eq)
watch_3 = Watch(filterByBoolMask.in)
vista_en_la_cual_insertar = Views(index=145)  # "VISTA EN LA CUAL INSERTAR PROYECCIONES"; graph input
perimeterCurves = Surface.PerimeterCurves(surface=filterByBoolMask.in)
byCurve = DetailCurve.ByCurve(view=vista_en_la_cual_insertar, curve=perimeterCurves)
string_2 = StringInput("Line Style")
line_style_name = StringInput("<Overhead>")  # graph input
python_script = Python(IN[0]=line_style_name)
# ---------- python_script.python (56 lines) ----------
#Copyright(c) 2015, Konrad Sobon
# @arch_laboratory, http://archi-lab.net

import clr
clr.AddReference('ProtoGeometry')
from Autodesk.DesignScript.Geometry import *

# Import DocumentManager and TransactionManager
clr.AddReference("RevitServices")
import RevitServices
from RevitServices.Persistence import DocumentManager

# Import RevitAPI
clr.AddReference("RevitAPI")
import Autodesk
from Autodesk.Revit.DB import *

doc = DocumentManager.Instance.CurrentDBDocument

import sys
pyt_path = r'C:\Program Files (x86)\IronPython 2.7\Lib'
sys.path.append(pyt_path)

#The inputs to this node will be stored as a list in the IN variable.
dataEnteringNode = IN

name = IN[0]

try:
	errorReport = None
	cat = Category.GetCategory(doc, BuiltInCategory.OST_Lines)
	gs = cat.GetGraphicsStyle(GraphicsStyleType.Projection)
	gsCat = gs.GraphicsStyleCategory.SubCategories
	lineStyles = [i.GetGraphicsStyle(GraphicsStyleType.Projection) for i in gsCat]
	
	lStyle = []
	try:
		lStyle.append(next(i for i in lineStyles if name==i.Name))
	except StopIteration:
		pass
	
	if len(lStyle) != 0:
		dataOut = lStyle[0]
	else:
		message = "No Line Style with specified \nname could be found."
		dataOut = '\n'.join('{:^35}'.format(s) for s in message.split('\n'))
except:
	# if error accurs anywhere in the process catch it
	import traceback
	errorReport = traceback.format_exc()

#Assign your output to the OUT variable
if errorReport == None:
	OUT = dataOut
else:
	OUT = errorReport
# ----------------------------------------
setParameterByName = Element.SetParameterByName(element=byCurve, parameterName=string_2, value=python_script)
flatten = List.Flatten(list=setParameterByName)
tipo_de_proyeccion = StringInput("PROYECCION LOSA")  # graph input
tipo_de_proyeccion_2 = StringInput("_")
add = tipo_de_proyeccion + tipo_de_proyeccion_2
string_3 = StringInput("Level")
getParameterValueByName = Element.GetParameterValueByName(element=watch, parameterName=string_3)
name = Level.Name(level=getParameterValueByName)
watch_4 = Watch(name)
add_2 = add + watch_4
python_script_2 = Python(IN[0]=flatten, IN[1]=add_2)
# ---------- python_script_2.python (30 lines) ----------
import clr
clr.AddReference('RevitAPI')
from Autodesk.Revit.DB import *
from System.Collections.Generic import *

clr.AddReference("RevitServices")
import RevitServices
from RevitServices.Persistence import DocumentManager
from RevitServices.Transactions import TransactionManager

doc = DocumentManager.Instance.CurrentDBDocument
items = UnwrapElement(IN[0])
ids = list()
rejects = list()
for item in items:
	try:
		ids.append(item.Id)
	except:
		rejects.append(item)
items = List[ElementId](ids)

TransactionManager.Instance.EnsureInTransaction(doc)
try:
	group = doc.Create.NewGroup(items);
	group.GroupType.Name = IN[1]
except:
	group = list()
TransactionManager.Instance.TransactionTaskDone()

OUT = (group,rejects)
# ----------------------------------------
code_block = CodeBlock(seq=python_script_2) { seq[0]; seq[1]; }
grupo_resultado = Watch(code_block.out0)  # graph output
