# Dynamo graph TAG_DeleteDuplicates.dyn (Dynamo 2.3.0.5885)

categories = Categories()  # nothing selected; graph input
current = Document.Current()
activeView = Document.ActiveView(document=current)
all_elements_of_category_in_view = ElementsOfCategoryInView(Category=categories, View=activeView)
python_script = Python(IN[0]=all_elements_of_category_in_view)
# ---------- python_script.python (87 lines) ----------
import clr
import sys

clr.AddReference("System")
from System.Collections.Generic import *

clr.AddReference("DSCoreNodes")
import DSCore
from DSCore import *

#Import RevitAPI
clr.AddReference('RevitAPI')
from Autodesk.Revit.DB import *

#Import RevitAPIUI
clr.AddReference("RevitAPIUI")
from Autodesk.Revit.UI import *
from Autodesk.Revit.UI.Selection import *

#Import DocumentManager and TransactionManager
clr.AddReference("RevitServices")
import RevitServices
from RevitServices.Persistence import DocumentManager
from RevitServices.Transactions import TransactionManager

#Import Dynamo Python References
clr.AddReference("ProtoGeometry")
from Autodesk.DesignScript.Geometry import *

#Import RevitNodes
clr.AddReference("RevitNodes")
import Revit

clr.ImportExtensions(Revit.Elements)
clr.ImportExtensions(Revit.GeometryConversion)


doc = DocumentManager.Instance.CurrentDBDocument
uidoc = DocumentManager.Instance.CurrentUIApplication.ActiveUIDocument

#Start coding from here:
tagList = UnwrapElement(IN[0])
hostList = []
dupList = []
baseList = []

tagCategory = tagList[0].Category.Name

if tagCategory == "Room Tags":
	TransactionManager.Instance.EnsureInTransaction(doc)
	for i in tagList:
		hostId = i.Room.Id
		hostList.append(hostId)
		if hostId not in baseList:
			baseList.append(hostId)
		else:
			dupList.append("Tag: "+i.TagText)
			doc.Delete(i.Id)
	TransactionManager.Instance.TransactionTaskDone()

if tagCategory == "Area Tags":
	TransactionManager.Instance.EnsureInTransaction(doc)
	for i in tagList:
		hostId = i.Area.Id
		hostList.append(hostId)
		if hostId not in baseList:
			baseList.append(hostId)
		else:
			dupList.append("Tag: "+i.TagText)
			doc.Delete(i.Id)
	TransactionManager.Instance.TransactionTaskDone()

else:
	TransactionManager.Instance.EnsureInTransaction(doc)
	for i in tagList:
		hostId = i.GetTaggedLocalElement().Id
		hostList.append(hostId)
		if hostId not in baseList:
			baseList.append(hostId)
		else:
			dupList.append("Tag: "+i.TagText)
			doc.Delete(i.Id)
	TransactionManager.Instance.TransactionTaskDone()

TaskDialog.Show("Delete Duplicates", str(len(dupList))+" elements were deleted from the view")

OUT = dupList
# ----------------------------------------
deleted_tags = Watch(python_script)  # graph output
