# Dynamo graph WALLS_PasosBuque.dyn (Dynamo 2.3.0.5885)

string = StringInput("Walls")
byName = Category.ByName(name=string)
all_elements_of_category = ElementsOfCategory(Category=byName)
wall_type_paso_buque = WallTypes("PasoBuque20cm")  # graph input
name = Element.Name(element=wall_type_paso_buque)
string_2 = StringInput("Type")
getParameterValueByName = Element.GetParameterValueByName(element=all_elements_of_category, parameterName=string_2)
watch = Watch(getParameterValueByName)
name_2 = Element.Name(element=watch)
eq = name == name_2
filterByBoolMask = List.FilterByBoolMask(list=all_elements_of_category, mask=eq)
delete = Element.Delete(element=filterByBoolMask.in)
watch_2 = Watch(filterByBoolMask.out)
string_3 = StringInput("Base Constraint")
getParameterValueByName_2 = Element.GetParameterValueByName(element=watch_2, parameterName=string_3)
watch_3 = Watch(getParameterValueByName_2)
name_3 = Level.Name(level=watch_3)
base_constraint_contains = StringInput("NPT")  # graph input
contains = String.Contains(str=name_3, searchFor=base_constraint_contains)
number = DoubleInput(1)
string_4 = StringInput("PasoBuque")
getParameterValueByName_3 = Element.GetParameterValueByName(element=watch_2, parameterName=string_4)
watch_4 = Watch(getParameterValueByName_3)
eq_2 = number == watch_4
and_ = contains && eq_2
filterByBoolMask_2 = List.FilterByBoolMask(list=watch_2, mask=and_)
wallLocationLine = Python(IN[0]=filterByBoolMask_2.in)
# ---------- wallLocationLine.python (50 lines) ----------
import clr
import sys

clr.AddReference("System")
from System.Collections.Generic import *

clr.AddReference("DSCoreNodes")
import DSCore
from DSCore import *

#Import RevitAPI
clr.AddReference('RevitAPI')
from Autodesk.Revit.DB import *

#Import RevitAPIUI
clr.AddReference("RevitAPIUI")
from Autodesk.Revit.UI import *
from Autodesk.Revit.UI.Selection import *
from Autodesk.Revit.UI.Selection import ISelectionFilter

#Import DocumentManager and TransactionManager
clr.AddReference("RevitServices")
import RevitServices
from RevitServices.Persistence import DocumentManager
from RevitServices.Transactions import TransactionManager

#Import Dynamo Python References
clr.AddReference("ProtoGeometry")
from Autodesk.DesignScript.Geometry import *

#Import RevitNodes
clr.AddReference("RevitNodes")
import Revit

clr.ImportExtensions(Revit.Elements)
clr.ImportExtensions(Revit.GeometryConversion)


doc = DocumentManager.Instance.CurrentDBDocument
uidoc = DocumentManager.Instance.CurrentUIApplication.ActiveUIDocument

#Start coding from here:

walls = UnwrapElement(IN[0])
wallsLine = []

for i in walls:
	wallsLine.append(i.Location.Curve.ToProtoType())

OUT = wallsLine
# ----------------------------------------
string_5 = StringInput("Levels")
byName_2 = Category.ByName(name=string_5)
all_elements_of_category_2 = ElementsOfCategory(Category=byName_2)
levelSorter = Python(IN[0]=all_elements_of_category_2)
# ---------- levelSorter.python (59 lines) ----------
import clr
import sys

clr.AddReference("System")
from System.Collections.Generic import *

clr.AddReference("DSCoreNodes")
import DSCore
from DSCore import *

#Import RevitAPI
clr.AddReference('RevitAPI')
from Autodesk.Revit.DB import *

#Import RevitAPIUI
clr.AddReference("RevitAPIUI")
from Autodesk.Revit.UI import *
from Autodesk.Revit.UI.Selection import *
from Autodesk.Revit.UI.Selection import ISelectionFilter

#Import DocumentManager and TransactionManager
clr.AddReference("RevitServices")
import RevitServices
from RevitServices.Persistence import DocumentManager
from RevitServices.Transactions import TransactionManager

#Import Dynamo Python References
clr.AddReference("ProtoGeometry")
from Autodesk.DesignScript.Geometry import *

#Import RevitNodes
clr.AddReference("RevitNodes")
import Revit

clr.ImportExtensions(Revit.Elements)
clr.ImportExtensions(Revit.GeometryConversion)


doc = DocumentManager.Instance.CurrentDBDocument
uidoc = DocumentManager.Instance.CurrentUIApplication.ActiveUIDocument

#Start coding from here:

levels = IN[0]
elevationList = []
levelDict = {}
outList = []

for i in levels:
	elevationList.append(i.Elevation)
	levelDict[i.Elevation] = i
	
elevationList.sort()

for i in elevationList:
	outList.append(levelDict[i])


OUT = outList
# ----------------------------------------
watch_5 = Watch(levelSorter)
string_6 = StringInput("Base Constraint")
getParameterValueByName_4 = Element.GetParameterValueByName(element=filterByBoolMask_2.in, parameterName=string_6)
watch_6 = Watch(getParameterValueByName_4)
indexOf = List.IndexOf(list=watch_5, element=watch_6)
number_2 = DoubleInput(1)
sub = indexOf - number_2
getItemAtIndex = List.GetItemAtIndex(list=watch_5, index=sub)
byCurveAndLevels = Wall.ByCurveAndLevels(c=wallLocationLine, startLevel=getItemAtIndex, endLevel=watch_6, wallType=wall_type_paso_buque)
string_7 = StringInput("Top Constraint")
setParameterByName = Element.SetParameterByName(element=byCurveAndLevels, parameterName=string_7, value=watch_6)
